# Grasshopper definition Faceshield.gh (Grasshopper 1.0.7)

留め具の接線_縦 = Slider(-15.5, range=-200..-10)
# 留め具付近の丸み
留め具の接線_横 = Slider(7.5, range=3..100)
留め具の位置_長さ = Slider(127.3, range=100..140)
# 留め具の座標
留め具の位置_幅 = Slider(85.2, range=50..100)
# 3. スキャンデータの読み込み
# RhinocerosのFile > Import で
# OBJ形式のスキャンデータを選択し読み込む
# 4. スキャンデータの位置調整
# Transform > Move や Transform > Rotate で
# おでこの中心が原点にくるように位置や向きを調整する
# 
# このときPerspectiveじゃなくてTop / Front / Rightの
# 画面で操作するのがおすすめ
# 5. スライダーを調整
# スライダーをドラッグしてパラメータの値を変えると
# フレームの形が変わる
# 頭部にフィットするまで調整する
# 額の丸み
額部分の接線_横 = Slider(86.1, range=1..100)
basecurves = BaseCurves(front=額部分の接線_横, back_x=留め具の接線_横, back_y=留め具の接線_縦, width=留め具の位置_幅, length=留め具の位置_長さ)  # -> base_curve, offset_curve
crv = Curve(basecurves.base_curve)
crv_2 = Curve(basecurves.offset_curve)
# Rhinocerosの基本的な操作
# 右クリック＆ドラッグで3D回転
# Shift+右クリックで移動
# マウスホイールで拡大縮小
# 困ったときはCtrl+Z
headsurface = HeadSurface(base_curve=crv, offset_curve=crv_2)  # -> shield_curve, cover, forehead
basesurface = BaseSurface(crv=crv, crv_2=crv_2)
Z = UnitZ(Factor=10)
Z_2 = UnitZ(Factor=-5)
crv_3 = Curve(headsurface.shield_curve)
pinsurfaces = PinSurfaces(shield_curve=crv_3, crv=basecurves.offset_curve)
srf = Surface(headsurface.cover)
srf_2 = Surface(basesurface)
srf_3 = Surface(pinsurfaces)
extr = Extrude(Base=srf, Direction=Z_2)
extr_2 = Extrude(Base=headsurface.forehead, Direction=Z)
extr_3 = Extrude(Base=srf_2, Direction=Z_2)
extr_4 = Extrude(Base=srf_3, Direction=Z_2)
brep = Brep(extr_4)
# Base & Pins
sunion = SolidUnion(Breps=flatten([extr_3, brep]))
# Logo
brep_2 = Brep([<brep referenced from the Rhino model> x6])
sunion_2 = SolidUnion(Breps=flatten([sunion, extr, extr_2, brep_2]))
# 6. STLデータを出力
# Grasshopper上でAllと書かれたBrepをBake
# 
# Rhinoceros上でBakeされたフレームを選択してから
# File > Export Selected で書き出し
# ファイルの種類はSTL
# All
brep_3 = Brep(sunion_2)

# ==== cluster PinSurfaces
shield_curve = ClusterInput()
crv = ClusterInput()
crv_2 = Curve(shield_curve)
crv_3 = Curve(crv)
num = Number(17.5)
num_2 = Number(5)
num_3 = Number(80)
addition = Addition(A=num, B=num_2)
addition_2 = Addition(A=num, B=num_3)
addition_3 = Addition(A=addition_2, B=num_2)
divlength = DivideLength(Curve=crv_2, Length="10")  # -> Points, Tangents, Parameters
addition_4 = Addition(A="150", B=5)
pinline = PinLine(C=crv_2, L=num)
pinline_2 = PinLine(C=crv_2, L=addition)
pinline_3 = PinLine(C=crv_2, L=addition_2)
pinline_4 = PinLine(C=crv_2, L=addition_3)
eval = EvaluateCurve(Curve=crv_3, Parameter="150")  # -> Point, Tangent, Angle
int = Integer(270)
eval_2 = EvaluateCurve(Curve=crv_3, Parameter=addition_4)  # -> Point, Tangent, Angle
rad = Radians(Degrees=int)
line = Line(pinline_2)
line_2 = Line(pinline_3)
line_3 = Line(pinline)
line_4 = Line(pinline_4)
pt = Point(eval.Point)
vrot = Rotate(Vector=eval.Tangent, Axis=Vector(0, 0, 1), Angle=rad)
vrot_2 = Rotate(Vector=eval_2.Tangent, Axis=Vector(0, 0, 1), Angle=rad)
pt_2 = Point(eval_2.Point)
end = EndPoints(Curve=line_3)  # -> Start, End
end_2 = EndPoints(Curve=line)  # -> Start, End
end_3 = EndPoints(Curve=line_2)  # -> Start, End
end_4 = EndPoints(Curve=line_4)  # -> Start, End
line_5 = LineSDL(Start=pt, Direction=vrot, Length=5)
line_6 = LineSDL(Start=pt_2, Direction=vrot_2, Length=8)
ln = Line(StartPoint=end.Start, EndPoint=end_2.Start)
ln_2 = Line(StartPoint=end_3.Start, EndPoint=end_4.Start)
ln_3 = Line(StartPoint=end.End, EndPoint=end_2.End)
ln_4 = Line(StartPoint=end_3.End, EndPoint=end_4.End)
end_5 = EndPoints(Curve=line_5)  # -> Start, End
end_6 = EndPoints(Curve=line_6)  # -> Start, End
join = JoinCurves(Curves=[line_3, ln_3, line], Preserve=False)
join_2 = JoinCurves(Curves=[line_2, ln_4, line_4], Preserve=False)
devec = DeconstructVector(Vector=end_6.End)  # -> XComponent, YComponent, ZComponent
devec_2 = DeconstructVector(Vector=end_5.End)  # -> XComponent, YComponent, ZComponent
fillet = Fillet(Curve=join, Radius=1)
fillet_2 = Fillet(Curve=join_2, Radius=1)
subtraction = Subtraction(A=devec.YComponent, B=12)
subtraction_2 = Subtraction(A=devec_2.YComponent, B=7)
join_3 = JoinCurves(Curves=[fillet, ln], Preserve=False)
join_4 = JoinCurves(Curves=[ln_2, fillet_2], Preserve=False)
vec = VectorXYZ(XComponent=devec.XComponent, YComponent=subtraction, ZComponent=devec.ZComponent)  # -> Vector, Length
vec_2 = VectorXYZ(XComponent=devec_2.XComponent, YComponent=subtraction_2, ZComponent=devec_2.ZComponent)  # -> Vector, Length
pt_3 = Point(vec_2.Vector)
pt_4 = Point(vec.Vector)
ln_5 = Line(StartPoint=end_6.End, EndPoint=pt_4)
ln_6 = Line(StartPoint=end_5.End, EndPoint=pt_3)
ln_7 = Line(StartPoint=pt_3, EndPoint=pt_4)
ln_8 = Line(StartPoint=end_5.Start, EndPoint=end_6.Start)
join_5 = JoinCurves(Curves=[line_5, line_6, ln_7, ln_6, ln_5], Preserve=False)
fillet_3 = Fillet(Curve=join_5, Radius=1)
join_6 = JoinCurves(Curves=[fillet_3, ln_8], Preserve=False)
mirror = Mirror(Geometry=[join_3, join_4, join_6], Plane=PlaneYZ(0, 0, 0))  # -> Geometry, Transform
boundary = BoundarySurfaces(Edges=[join_3, join_4, mirror.Geometry, join_6])
S = ClusterOutput(boundary)

# ==== cluster BaseSurface
crv = ClusterInput()
crv_2 = ClusterInput()
crv_3 = Curve(crv)
crv_4 = Curve(crv_2)
end = EndPoints(Curve=crv_3)  # -> Start, End
end_2 = EndPoints(Curve=crv_4)  # -> Start, End
ln = Line(StartPoint=end.End, EndPoint=end_2.End)
join = JoinCurves(Curves=flatten([crv_4, crv_3, ln]), Preserve=False)
mirror = Mirror(Geometry=join, Plane=PlaneYZ(0, 0, 0))  # -> Geometry, Transform
join_2 = JoinCurves(Curves=[join, mirror.Geometry], Preserve=False)
fillet = Fillet(Curve=join_2, Radius=1)
boundary = BoundarySurfaces(Edges=fillet)
S = ClusterOutput(boundary)

# ==== cluster BaseCurves
front = ClusterInput()
back_x = ClusterInput()
back_y = ClusterInput()
length = ClusterInput()
pt = Point(Point(0, 0, 0))
width = ClusterInput()
pt_2 = ConstructPoint(XCoordinate=width, YCoordinate=length, ZCoordinate=0)
X = UnitX(Factor=front)
vec = VectorXYZ(XComponent=back_x, YComponent=back_y, ZComponent=0)  # -> Vector, Length
devec = DeconstructVector(Vector=pt_2)  # -> XComponent, YComponent, ZComponent
bzspan = BezierSpan(StartPoint=pt, StartTangent=X, EndPoint=pt_2, EndTangent=vec.Vector)  # -> Curve, Length, Domain
addition = Addition(A=devec.YComponent, B=5)
addition_2 = Addition(A=devec.XComponent, B=15)
vec_2 = VectorXYZ(XComponent=addition_2, YComponent=addition, ZComponent=devec.ZComponent)  # -> Vector, Length
pt_3 = Point(vec_2.Vector)
arc = ArcSED(Start=pt_2, End=pt_3, Direction="-1,2,0")  # -> Arc, Plane, Radius
join = JoinCurves(Curves=[bzspan.Curve, arc.Arc], Preserve=False)
offset = OffsetCurve(Curve=join, Distance=4, Plane=PlaneXY(0, 0, 0), Corners=1)
base_curve = ClusterOutput(join)
offset_curve = ClusterOutput(offset)

# ==== cluster HeadSurface
base_curve = ClusterInput()
offset_curve = ClusterInput()
crv = Curve(offset_curve)
crv_2 = Curve(base_curve)
mirror = Mirror(Geometry=crv_2, Plane=PlaneYZ(0, 0, 0))  # -> Geometry, Transform
mirror_2 = Mirror(Geometry=crv, Plane=PlaneYZ(0, 0, 0))  # -> Geometry, Transform
join = JoinCurves(Curves=[crv_2, mirror.Geometry], Preserve=False)
Y = UnitY(Factor="-40")
eval = EvaluateCurve(Curve=crv, Parameter="120")  # -> Point, Tangent, Angle
vec = Vector(Vector(40, 0, 0))
move = Move(Geometry=eval.Point, Motion=Y)  # -> Geometry, Transform
vec_2 = Vector(Vector(-10, -30, 0))
pt = Point(Point(0, -45, 0))
bzspan = BezierSpan(StartPoint=pt, StartTangent=vec, EndPoint=move.Geometry, EndTangent=vec_2)  # -> Curve, Length, Domain
mirror_3 = Mirror(Geometry=bzspan.Curve, Plane=PlaneYZ(0, 0, 0))  # -> Geometry, Transform
ln = Line(StartPoint=eval.Point, EndPoint=move.Geometry)
ext = ExtendCurve(Curve=ln, Type=0, Start=10, End=0)
mirror_4 = Mirror(Geometry=ext, Plane=PlaneYZ(0, 0, 0))  # -> Geometry, Transform
end = EndPoints(Curve=ext)  # -> Start, End
end_2 = EndPoints(Curve=mirror_4.Geometry)  # -> Start, End
ln_2 = Line(StartPoint=end.Start, EndPoint=end_2.Start)
join_2 = JoinCurves(Curves=[bzspan.Curve, ext, mirror_4.Geometry, mirror_3.Geometry], Preserve=False)
shield_curve = ClusterOutput(bzspan.Curve)
fillet = Fillet(Curve=join_2, Radius=2)
join_3 = JoinCurves(Curves=[fillet, ln_2], Preserve=False)
join_4 = JoinCurves(Curves=[crv, mirror_2.Geometry], Preserve=False)
boundary = BoundarySurfaces(Edges=join_3)
srfsplit = SurfaceSplit(Surface=boundary, Curves=join_4)
item = ListItem(List=srfsplit, Index=0, Wrap=True)
srfsplit_2 = SurfaceSplit(Surface=item, Curves=join)
item_2 = ListItem(List=srfsplit, Index=1, Wrap=True)
cover = ClusterOutput(item_2)
item_3 = ListItem(List=srfsplit_2, Index=1, Wrap=True)
forehead = ClusterOutput(item_3)

# ==== cluster PinLine
C = ClusterInput()
L = ClusterInput()
divlength = DivideLength(Curve=C, Length=L)  # -> Points, Tangents, Parameters
int = Integer(270)
item = ListItem(List=divlength.Tangents, Index=1, Wrap=True)
rad = Radians(Degrees=int)
vrot = Rotate(Vector=item, Axis=Vector(0, 0, 1), Angle=rad)
item_2 = ListItem(List=divlength.Points, Index=1, Wrap=True)
line = LineSDL(Start=item_2, Direction=vrot, Length=4)
L_2 = ClusterOutput(line)
