# Grasshopper definition FaceshieldApp.gh (Grasshopper 1.0.7)
# plug-ins: Human UI

# 留め具の接線
留め具の接線_横 = Slider(19.2, range=10..200)
留め具の接線_縦 = Slider(-51.9, range=-200..-10)
# 留め具の座標
留め具の位置_幅 = Slider(85.2, range=50..100)
留め具の位置_長さ = Slider(139.5, range=100..250)
# 額の接線
額部分の接線_横 = Slider(67.4, range=1..100)
number_slider = Slider(416, range=0..2000)

mesh = Mesh(<mesh referenced from the Rhino model>)
col = Colour(RGB(140, 140, 140))

slider = CreateSlider(Slider=額部分の接線_横, ShowBounds=False, ShowTicks=False, ShowTooltip=False, ShowValLabel=True, showLabel=True)
slider_2 = CreateSlider(Slider=留め具の接線_横, ShowBounds=False, ShowTicks=False, ShowTooltip=False, ShowValLabel=True, showLabel=True)
slider_3 = CreateSlider(Slider=留め具の接線_縦, ShowBounds=False, ShowTicks=False, ShowTooltip=False, ShowValLabel=True, showLabel=True)
slider_4 = CreateSlider(Slider=留め具の位置_幅, ShowBounds=False, ShowTicks=False, ShowTooltip=False, ShowValLabel=True, showLabel=True)
slider_5 = CreateSlider(Slider=留め具の位置_長さ, ShowBounds=False, ShowTicks=False, ShowTooltip=False, ShowValLabel=True, showLabel=True)
col_2 = Colour(RGB(82, 180, 255))
values = ValueListener(Elements=slider, SomeProperty=True)  # -> Values, Indices
values_2 = ValueListener(Elements=slider_2, SomeProperty=True)  # -> Values, Indices
values_3 = ValueListener(Elements=slider_3, SomeProperty=True)  # -> Values, Indices
values_4 = ValueListener(Elements=slider_4, SomeProperty=True)  # -> Values, Indices
values_5 = ValueListener(Elements=slider_5, SomeProperty=True)  # -> Values, Indices
txt = Text("Params")
expander = CreateExpander(UIElements=[slider, slider_2, slider_3, slider_4, slider_5], Header=txt, Open=True)
basecurves = BaseCurves(front=values.Values, back_x=values_2.Values, back_y=values_3.Values, width=values_4.Values, length=values_5.Values)  # -> base_curve, offset_curve

# ----
# Window
toggle = BooleanToggle(True)
txt_2 = Text("Faceshield")
launchwin = LaunchWindow(
    Show=toggle,
    Name=txt_2,
    Width=Slider(1200, range=0..2000),
    Height=Slider(600, range=0..2000),
    ChildStatus=0,
    EnableHorizScroll=False)
winprops = SetWindowProperties(Window=launchwin, Theme=0, AccentColor="blue", ShowTitleBar=True, BackgroundColor=RGB(255, 255, 255), ScaleFactor=1)

adjustpos = AdjustElementPositioning(ElementsToAdjust=expander, Margin="5", AbsolutePositioning=False, Width=300, Height=250)
crv = Curve(basecurves.base_curve)
crv_2 = Curve(basecurves.offset_curve)
headsurface = HeadSurface(base_curve=crv, offset_curve=crv_2)  # -> shield_curve, cover, forehead
basesurface = BaseSurface(crv=crv, crv_2=crv_2)
Z = UnitZ(Factor=10)
Z_2 = UnitZ(Factor=-5)
srf = Surface(basesurface)
srf_2 = Surface(headsurface.cover)
crv_3 = Curve(headsurface.shield_curve)
pinsurfaces = PinSurfaces(shield_curve=crv_3, crv=basecurves.offset_curve)
srf_3 = Surface(pinsurfaces)
extr = Extrude(Base=srf_3, Direction=Z_2)
extr_2 = Extrude(Base=srf, Direction=Z_2)
extr_3 = Extrude(Base=srf_2, Direction=Z_2)
extr_4 = Extrude(Base=headsurface.forehead, Direction=Z)
brep = Brep(extr)
# Base & Pins
sunion = SolidUnion(Breps=flatten([extr_2, brep]))
# All
sunion_2 = SolidUnion(Breps=flatten([sunion, extr_3, extr_4]))

# ----
# Faceshield View
colorpicker = CreateColorPicker()
box = Box({Plane=Plane(origin=(-3.592424852, -18.23594572, 0), x=(0, 1, 0), y=(1, 0, 0)), X=Domain(0, 36.2283521), Y=Domain(0, 50.20017838), Z=Domain(-20.6734773, 0)})
_3dview = Create3DView(MeshToDisplay=box, MeshColors=RGB(255, 0, 0), ViewWidth=300, ViewHeight=300)
values_6 = ValueListener(Elements=colorpicker, SomeProperty=True)  # -> Values, Indices
viewbox = CreateViewBox(UIElements=_3dview, Width=number_slider, Height=number_slider)
mesh_2 = Mesh(sunion_2)
set3dview = Set3DView(_3DView=_3dview, MeshToDisplay=mesh_2, MeshColors=col_2)

# ----
# Face View
box_2 = Box({Plane=PlaneXY(-148.9067408, -43.01680204, -100), X=Domain(0, 335.8040976), Y=Domain(0, 296.2510669), Z=Domain(0, 300)})
_3dview_2 = Create3DView(MeshToDisplay=box_2, MeshColors=RGB(255, 0, 0), ViewWidth=300, ViewHeight=300)
viewbox_2 = CreateViewBox(UIElements=_3dview_2, Width=number_slider, Height=number_slider)
set3dview_2 = Set3DView(_3DView=_3dview_2, MeshToDisplay=[sunion_2, mesh], MeshColors=[col_2, col])

stack = CreateStack(UIElements=[viewbox, viewbox_2], Horizontal=True)
adjustpos_2 = AdjustElementPositioning(ElementsToAdjust=[viewbox, viewbox_2], Margin="5", AbsolutePositioning=False, Width=number_slider, Height=number_slider)
stack_2 = CreateStack(UIElements=[stack, expander], Horizontal=True)
addelems = AddElements(Window=launchwin, Elements=flatten(stack_2), DoVLChecking=True)  # -> AddedElements, ElementNames

# ==== cluster PinSurfaces
shield_curve = ClusterInput()
crv = ClusterInput()
crv_2 = Curve(shield_curve)
crv_3 = Curve(crv)
num = Number(17.5)
num_2 = Number(5)
num_3 = Number(80)
addition = Addition(A=num, B=num_2)
addition_2 = Addition(A=num, B=num_3)
addition_3 = Addition(A=addition_2, B=num_2)
divlength = DivideLength(Curve=crv_2, Length="10")  # -> Points, Tangents, Parameters
addition_4 = Addition(A="150", B=5)
pinline = PinLine(C=crv_2, L=num)
pinline_2 = PinLine(C=crv_2, L=addition)
pinline_3 = PinLine(C=crv_2, L=addition_2)
pinline_4 = PinLine(C=crv_2, L=addition_3)
eval = EvaluateCurve(Curve=crv_3, Parameter="150")  # -> Point, Tangent, Angle
int = Integer(270)
eval_2 = EvaluateCurve(Curve=crv_3, Parameter=addition_4)  # -> Point, Tangent, Angle
rad = Radians(Degrees=int)
line = Line(pinline_2)
line_2 = Line(pinline_3)
line_3 = Line(pinline)
line_4 = Line(pinline_4)
pt = Point(eval.Point)
vrot = Rotate(Vector=eval.Tangent, Axis=Vector(0, 0, 1), Angle=rad)
vrot_2 = Rotate(Vector=eval_2.Tangent, Axis=Vector(0, 0, 1), Angle=rad)
pt_2 = Point(eval_2.Point)
end = EndPoints(Curve=line_3)  # -> Start, End
end_2 = EndPoints(Curve=line)  # -> Start, End
end_3 = EndPoints(Curve=line_2)  # -> Start, End
end_4 = EndPoints(Curve=line_4)  # -> Start, End
line_5 = LineSDL(Start=pt, Direction=vrot, Length=5)
line_6 = LineSDL(Start=pt_2, Direction=vrot_2, Length=8)
ln = Line(StartPoint=end.Start, EndPoint=end_2.Start)
ln_2 = Line(StartPoint=end_3.Start, EndPoint=end_4.Start)
ln_3 = Line(StartPoint=end.End, EndPoint=end_2.End)
ln_4 = Line(StartPoint=end_3.End, EndPoint=end_4.End)
end_5 = EndPoints(Curve=line_5)  # -> Start, End
end_6 = EndPoints(Curve=line_6)  # -> Start, End
join = JoinCurves(Curves=[line_3, ln_3, line], Preserve=False)
join_2 = JoinCurves(Curves=[line_2, ln_4, line_4], Preserve=False)
devec = DeconstructVector(Vector=end_6.End)  # -> XComponent, YComponent, ZComponent
devec_2 = DeconstructVector(Vector=end_5.End)  # -> XComponent, YComponent, ZComponent
fillet = Fillet(Curve=join, Radius=1)
fillet_2 = Fillet(Curve=join_2, Radius=1)
subtraction = Subtraction(A=devec.YComponent, B=12)
subtraction_2 = Subtraction(A=devec_2.YComponent, B=7)
join_3 = JoinCurves(Curves=[fillet, ln], Preserve=False)
join_4 = JoinCurves(Curves=[ln_2, fillet_2], Preserve=False)
vec = VectorXYZ(XComponent=devec.XComponent, YComponent=subtraction, ZComponent=devec.ZComponent)  # -> Vector, Length
vec_2 = VectorXYZ(XComponent=devec_2.XComponent, YComponent=subtraction_2, ZComponent=devec_2.ZComponent)  # -> Vector, Length
pt_3 = Point(vec_2.Vector)
pt_4 = Point(vec.Vector)
ln_5 = Line(StartPoint=end_6.End, EndPoint=pt_4)
ln_6 = Line(StartPoint=end_5.End, EndPoint=pt_3)
ln_7 = Line(StartPoint=pt_3, EndPoint=pt_4)
ln_8 = Line(StartPoint=end_5.Start, EndPoint=end_6.Start)
join_5 = JoinCurves(Curves=[line_5, line_6, ln_7, ln_6, ln_5], Preserve=False)
fillet_3 = Fillet(Curve=join_5, Radius=1)
join_6 = JoinCurves(Curves=[fillet_3, ln_8], Preserve=False)
mirror = Mirror(Geometry=[join_3, join_4, join_6], Plane=PlaneYZ(0, 0, 0))  # -> Geometry, Transform
boundary = BoundarySurfaces(Edges=[join_3, join_4, mirror.Geometry, join_6])
S = ClusterOutput(boundary)

# ==== cluster BaseSurface
crv = ClusterInput()
crv_2 = ClusterInput()
crv_3 = Curve(crv)
crv_4 = Curve(crv_2)
end = EndPoints(Curve=crv_3)  # -> Start, End
end_2 = EndPoints(Curve=crv_4)  # -> Start, End
ln = Line(StartPoint=end.End, EndPoint=end_2.End)
join = JoinCurves(Curves=flatten([crv_4, crv_3, ln]), Preserve=False)
mirror = Mirror(Geometry=join, Plane=PlaneYZ(0, 0, 0))  # -> Geometry, Transform
join_2 = JoinCurves(Curves=[join, mirror.Geometry], Preserve=False)
fillet = Fillet(Curve=join_2, Radius=1)
boundary = BoundarySurfaces(Edges=fillet)
S = ClusterOutput(boundary)

# ==== cluster BaseCurves
front = ClusterInput()
back_x = ClusterInput()
back_y = ClusterInput()
length = ClusterInput()
pt = Point(Point(0, 0, 0))
width = ClusterInput()
pt_2 = ConstructPoint(XCoordinate=width, YCoordinate=length, ZCoordinate=0)
X = UnitX(Factor=front)
vec = VectorXYZ(XComponent=back_x, YComponent=back_y, ZComponent=0)  # -> Vector, Length
devec = DeconstructVector(Vector=pt_2)  # -> XComponent, YComponent, ZComponent
bzspan = BezierSpan(StartPoint=pt, StartTangent=X, EndPoint=pt_2, EndTangent=vec.Vector)  # -> Curve, Length, Domain
addition = Addition(A=devec.YComponent, B=5)
addition_2 = Addition(A=devec.XComponent, B=15)
vec_2 = VectorXYZ(XComponent=addition_2, YComponent=addition, ZComponent=devec.ZComponent)  # -> Vector, Length
pt_3 = Point(vec_2.Vector)
arc = ArcSED(Start=pt_2, End=pt_3, Direction="-1,2,0")  # -> Arc, Plane, Radius
join = JoinCurves(Curves=[bzspan.Curve, arc.Arc], Preserve=False)
offset = OffsetCurve(Curve=join, Distance=4, Plane=PlaneXY(0, 0, 0), Corners=1)
base_curve = ClusterOutput(join)
offset_curve = ClusterOutput(offset)

# ==== cluster HeadSurface
base_curve = ClusterInput()
offset_curve = ClusterInput()
crv = Curve(offset_curve)
crv_2 = Curve(base_curve)
mirror = Mirror(Geometry=crv_2, Plane=PlaneYZ(0, 0, 0))  # -> Geometry, Transform
mirror_2 = Mirror(Geometry=crv, Plane=PlaneYZ(0, 0, 0))  # -> Geometry, Transform
join = JoinCurves(Curves=[crv_2, mirror.Geometry], Preserve=False)
Y = UnitY(Factor="-40")
eval = EvaluateCurve(Curve=crv, Parameter="120")  # -> Point, Tangent, Angle
vec = Vector(Vector(40, 0, 0))
move = Move(Geometry=eval.Point, Motion=Y)  # -> Geometry, Transform
vec_2 = Vector(Vector(-10, -30, 0))
pt = Point(Point(0, -45, 0))
bzspan = BezierSpan(StartPoint=pt, StartTangent=vec, EndPoint=move.Geometry, EndTangent=vec_2)  # -> Curve, Length, Domain
mirror_3 = Mirror(Geometry=bzspan.Curve, Plane=PlaneYZ(0, 0, 0))  # -> Geometry, Transform
ln = Line(StartPoint=eval.Point, EndPoint=move.Geometry)
ext = ExtendCurve(Curve=ln, Type=0, Start=10, End=0)
mirror_4 = Mirror(Geometry=ext, Plane=PlaneYZ(0, 0, 0))  # -> Geometry, Transform
end = EndPoints(Curve=ext)  # -> Start, End
end_2 = EndPoints(Curve=mirror_4.Geometry)  # -> Start, End
ln_2 = Line(StartPoint=end.Start, EndPoint=end_2.Start)
join_2 = JoinCurves(Curves=[bzspan.Curve, ext, mirror_4.Geometry, mirror_3.Geometry], Preserve=False)
shield_curve = ClusterOutput(bzspan.Curve)
fillet = Fillet(Curve=join_2, Radius=2)
join_3 = JoinCurves(Curves=[fillet, ln_2], Preserve=False)
join_4 = JoinCurves(Curves=[crv, mirror_2.Geometry], Preserve=False)
boundary = BoundarySurfaces(Edges=join_3)
srfsplit = SurfaceSplit(Surface=boundary, Curves=join_4)
item = ListItem(List=srfsplit, Index=0, Wrap=True)
srfsplit_2 = SurfaceSplit(Surface=item, Curves=join)
item_2 = ListItem(List=srfsplit, Index=1, Wrap=True)
cover = ClusterOutput(item_2)
item_3 = ListItem(List=srfsplit_2, Index=1, Wrap=True)
forehead = ClusterOutput(item_3)

# ==== cluster PinLine
C = ClusterInput()
L = ClusterInput()
divlength = DivideLength(Curve=C, Length=L)  # -> Points, Tangents, Parameters
int = Integer(270)
item = ListItem(List=divlength.Tangents, Index=1, Wrap=True)
rad = Radians(Degrees=int)
vrot = Rotate(Vector=item, Axis=Vector(0, 0, 1), Angle=rad)
item_2 = ListItem(List=divlength.Points, Index=1, Wrap=True)
line = LineSDL(Start=item_2, Direction=vrot, Length=4)
L_2 = ClusterOutput(line)
